# Dynamo graph criar_parametro_sinapi.dyn (Dynamo 1.3.3.4111)

code_block = CodeBlock { "cod_composicao"; "PG_IDENTITY_DATA"; "Text"; false; }
all_elements_in_active_view = ElementsInView()
getCategory = Element.GetCategory(all_elements_in_active_view)
createProjectParameter = Parameter.CreateProjectParameter(code_block.out0, code_block.out1, code_block.out2, code_block.out1, code_block.out3, getCategory)
