# Dynamo graph exporta_planilha_de_quantidades.dyn (Dynamo 1.3.3.4111)

code_block = CodeBlock { "inf.xlsx"; "inf"; 0; }
code_block_2 = CodeBlock { "unidades.xlsx"; }
fromPath = FileObject(code_block_2)  # "File.FromPath"
code_block_3 = CodeBlock { "Unidades"; true; }
readFromFile = Excel.ReadFromFile(file=fromPath, sheetName=code_block_3.out0, readAsStrings=code_block_3.out1)
python_script = Python(IN[0]=readFromFile)
# ---------- python_script.python (11 lines) ----------
import clr
clr.AddReference('ProtoGeometry')
from Autodesk.DesignScript.Geometry import *

saida = []
i = 0
for linha in IN[0]:
	if i > 0:
		saida.append([linha[1],linha[2]])
	i+=1
OUT = saida
# ----------------------------------------
all_elements_in_active_view = ElementsInView()
code_block_4 = CodeBlock { "cod_composicao"; }
parameterByName = Parameter.ParameterByName(element=all_elements_in_active_view, name=code_block_4)
value = Parameter.Value(parameterByName)
python_script_2 = Python(IN[0]=value, IN[1]=all_elements_in_active_view)
# ---------- python_script_2.python (12 lines) ----------
import clr
clr.AddReference('ProtoGeometry')
from Autodesk.DesignScript.Geometry import *
#As entradas para este nó serão armazenadas como uma lista nas variáveis IN.
filter = [p for p in IN[0] if p ]
elements = []

for i in range(len(IN[0])):
	if IN[0][i]:
		elements.append(IN[1][i])
#Atribua a sua saída para a variável OUT.
OUT = [filter,elements]
# ----------------------------------------
code_block_5 = CodeBlock(a=python_script_2) { a; a[1]; }
code_block_6 = CodeBlock { "Área"; }
parameterByName_2 = Parameter.ParameterByName(element=code_block_5.out1, name=code_block_6)
value_2 = Parameter.Value(parameterByName_2)
code_block_7 = CodeBlock { "Volume"; }
parameterByName_3 = Parameter.ParameterByName(element=code_block_5.out1, name=code_block_7)
value_3 = Parameter.Value(parameterByName_3)
python_script_3 = Python(IN[0]=python_script, IN[1]=python_script_2, IN[2]=value_2, IN[3]=value_3)
# ---------- python_script_3.python (44 lines) ----------
import clr
clr.AddReference('ProtoGeometry')
from Autodesk.DesignScript.Geometry import *
#As entradas para este nó serão armazenadas como uma lista nas variáveis IN.

def un(tabela, codigo):
	opt = 0
	for linha in tabela:
		if str(linha[0]) == str(codigo):
			opt = linha[1]
			break
	return opt

def quantidade(codigo, allCods, elementos,a,v):
	qnt = 0
	if codigo[1] == 'UN':
		for cod in allCods:
			if str(cod) == str(codigo[0]):
				qnt += 1
	if codigo[1] == 'M2':
		for i in range(len(a)):
			if str(allCods[i]) == str(codigo[0]):
				qnt += a[i]
	if codigo[1] == 'M3':
		for i in range(len(a)):
			if str(allCods[i]) == str(codigo[0]):
				qnt += v[i]
	return qnt

table = IN[0]
elements = IN[1][1]
cods = IN[1][0]
areas = IN[2]
volume = IN[3]
codigosPresentes = list(set(cods))
codInf = []


for cod in codigosPresentes:
	codInf.append([cod,un(table,cod)])

qntidades = [[c[0],quantidade(c,cods,elements,areas, volume),c[1]] for c in codInf]
#Atribua a sua saída para a variável OUT.
OUT = qntidades
# ----------------------------------------
writeToFile = Excel.WriteToFile(filePath=code_block.out0, sheetName=code_block.out1, startRow=code_block.out2, startCol=code_block.out2, data=python_script_3)
