# Dynamo graph inserir_cod_para_varios_elementos.dyn (Dynamo 1.3.3.4111)

select_model_elements = DSModelElementsSelection()
code_block = CodeBlock { "cod_composicao"; }
parameterByName = Parameter.ParameterByName(element=select_model_elements, name=code_block)
flatten = Flatten(parameterByName)
codigo_da_composicao = StringInput("")
setValue = Parameter.SetValue(flatten, codigo_da_composicao)
