# Dynamo graph inserir_cod_por_familia.dyn (Dynamo 1.3.3.4111)

familia = FamilyTypes("CX AGUA - FORTLEV:1000 L")
all_elements_of_family_type = ElementsOfFamilyType(familia)
code_block = CodeBlock { "cod_composicao"; }
parameterByName = Parameter.ParameterByName(element=all_elements_of_family_type, name=code_block)
codigo_da_composicao = StringInput("")
setValue = Parameter.SetValue(parameterByName, codigo_da_composicao)
